# Grasshopper definition osm-map.gh (Grasshopper 1.0.7)

panel = Panel("C:\Users\ASUS\Documents\GitHub\HACKERSPACE\pycity-generator\rhinoceros\map.osm")
list = ValueList({"highway", "building"}, selected="building")
loc = Location(FilePText=panel)  # -> OSMPointData, OSMData, LongitudeDomain, LatitudeDomain
genosm = GenericOSM(OSMPointData=loc.OSMPointData, OSMDataText=loc.OSMData, FeatureKey=list, FeatureValue="*", CollectionType=0)  # -> FeaturePoints, FeatureKey
Z = UnitZ(Factor=Slider(1000, range=0..1000))
pline = PolyLine(Vertices=genosm.FeaturePoints, Closed=True)
boundary = BoundarySurfaces(Edges=pline)
extr = Extrude(Base=boundary, Direction=Z)
panel_2 = Panel(genosm.FeaturePoints)
